test file "CruiseControlTests_Coverage"
  coverage: Decision, MCDC, Condition

suite "Functional_Test_Coverage"

  case "SB_Initial_Coverage" [simulation]
    model CruiseControl, harness CruiseControl_Harness_SB, mode Normal
    signal scenario: Init Not Enable or Engaged (CruiseControl_Harness_SB/Harness Inputs)
    iterations:
      Init Not Enable or Engaged: SignalBuilderGroup "Init Not Enable or Engaged"
      Not Engaged with Enable: SignalBuilderGroup "Not Engaged with Enable"
      Disengage with Disable: SignalBuilderGroup "Disengage with Disable"
      Engage 1st with CoastSetSW: SignalBuilderGroup "Engage 1st with CoastSetSW"
      No Engage 1st with AccelResSW: SignalBuilderGroup "No Engage 1st with AccelResSW"
      Disengage with Brake: SignalBuilderGroup "Disengage with Brake"
      Re-Engage with CoastSetSw: SignalBuilderGroup "Re-Engage with CoastSetSw"
      Re-Engage with AccelResSw: SignalBuilderGroup "Re-Engage with AccelResSw"
      Engaged Decel with CoastSetSW: SignalBuilderGroup "Engaged Decel with CoastSetSW"
      Engaged Accel with AccelResSW: SignalBuilderGroup "Engaged Accel with AccelResSW"
      Engagd Decel with CoastSet Hold: SignalBuilderGroup "Engagd Decel with CoastSet Hold"
      Engagd Accel with AccelRes Hold: SignalBuilderGroup "Engagd Accel with AccelRes Hold"
      Engage CoastSetSw Veh Spd: SignalBuilderGroup "Engage CoastSetSw Veh Spd"
      Engage AccelResSw Veh Spd: SignalBuilderGroup "Engage AccelResSw Veh Spd"

  case "SB_Full_Coverage" [simulation]
    model CruiseControl, harness CruiseControl_Harness_SB_Full, mode Normal
    iterations:
      Init Not Enable or Engaged: SignalBuilderGroup "Init Not Enable or Engaged"
      Not Engaged with Enable: SignalBuilderGroup "Not Engaged with Enable"
      Disengage with Disable: SignalBuilderGroup "Disengage with Disable"
      Engage 1st with CoastSetSW: SignalBuilderGroup "Engage 1st with CoastSetSW"
      No Engage 1st with AccelResSW: SignalBuilderGroup "No Engage 1st with AccelResSW"
      Disengage with Brake: SignalBuilderGroup "Disengage with Brake"
      Re-Engage with CoastSetSw: SignalBuilderGroup "Re-Engage with CoastSetSw"
      Re-Engage with AccelResSw: SignalBuilderGroup "Re-Engage with AccelResSw"
      Engaged Decel with CoastSetSW: SignalBuilderGroup "Engaged Decel with CoastSetSW"
      Engaged Accel with AccelResSW: SignalBuilderGroup "Engaged Accel with AccelResSW"
      Engagd Decel with CoastSet Hold: SignalBuilderGroup "Engagd Decel with CoastSet Hold"
      Engagd Accel with AccelRes Hold: SignalBuilderGroup "Engagd Accel with AccelRes Hold"
      Engage CoastSetSw Veh Spd: SignalBuilderGroup "Engage CoastSetSw Veh Spd"
      Engage AccelResSw Veh Spd: SignalBuilderGroup "Engage AccelResSw Veh Spd"
      Engage Veh Spd Edge: SignalBuilderGroup "Engage Veh Spd Edge"
      Disengage Veh Spd Edge: SignalBuilderGroup "Disengage Veh Spd Edge"
      Disengage from CoastSet Hold: SignalBuilderGroup "Disengage from CoastSet Hold"
      Disengage from AccelRes Hold: SignalBuilderGroup "Disengage from AccelRes Hold"
      Disengage Veh Spd Edge Hold: SignalBuilderGroup "Disengage Veh Spd Edge Hold"

  case "SB_Full_Coverage_SIL" [simulation]
    model CruiseControl, harness CruiseControl_Harness_SB_Full, mode Software-in-the-Loop (SIL)
    iterations:
      Init Not Enable or Engaged: SignalBuilderGroup "Init Not Enable or Engaged"
      Not Engaged with Enable: SignalBuilderGroup "Not Engaged with Enable"
      Disengage with Disable: SignalBuilderGroup "Disengage with Disable"
      Engage 1st with CoastSetSW: SignalBuilderGroup "Engage 1st with CoastSetSW"
      No Engage 1st with AccelResSW: SignalBuilderGroup "No Engage 1st with AccelResSW"
      Disengage with Brake: SignalBuilderGroup "Disengage with Brake"
      Re-Engage with CoastSetSw: SignalBuilderGroup "Re-Engage with CoastSetSw"
      Re-Engage with AccelResSw: SignalBuilderGroup "Re-Engage with AccelResSw"
      Engaged Decel with CoastSetSW: SignalBuilderGroup "Engaged Decel with CoastSetSW"
      Engaged Accel with AccelResSW: SignalBuilderGroup "Engaged Accel with AccelResSW"
      Engagd Decel with CoastSet Hold: SignalBuilderGroup "Engagd Decel with CoastSet Hold"
      Engagd Accel with AccelRes Hold: SignalBuilderGroup "Engagd Accel with AccelRes Hold"
      Engage CoastSetSw Veh Spd: SignalBuilderGroup "Engage CoastSetSw Veh Spd"
      Engage AccelResSw Veh Spd: SignalBuilderGroup "Engage AccelResSw Veh Spd"
      Engage Veh Spd Edge: SignalBuilderGroup "Engage Veh Spd Edge"
      Disengage Veh Spd Edge: SignalBuilderGroup "Disengage Veh Spd Edge"
      Disengage from CoastSet Hold: SignalBuilderGroup "Disengage from CoastSet Hold"
      Disengage from AccelRes Hold: SignalBuilderGroup "Disengage from AccelRes Hold"
      Disengage Veh Spd Edge Hold: SignalBuilderGroup "Disengage Veh Spd Edge Hold"

suite "Equivalence_Test"

  case "SB_Equiv_Full_Cov_ReqsBased" [equivalence]
    simulation 1:
      model CruiseControl, harness CruiseControl_Harness_SB_Full
    simulation 2:
      model CruiseControl_SIL, harness CruiseControl_Harness_SB_Full_SIL
    equivalence criteria
      engaged
      tspeed
      Exp_engaged
      Exp_tspeed
      AccelResSw
      Brake
      CoastSetSw
      CruiseOnOff
      Speed
      engaged_Assertion
      tspeed_Assertion
    custom criteria (off):
      % Return value: customCriteria
      % set customCriteria.out to true for pass and false for fail
      % set customCriteria.logs (cell array) for log messages
      % set customCriteria.errors (cell array) for error messages

      customCriteria.out = true;
    iteration script:
      %% Iterate over all Signal Builder Groups.

      % Determine the number of possible iterations
      numSteps = min(length(sltest_signalBuilderGroups{1}), length(sltest_signalBuilderGroups{2}));

      % Create each iteration
      for k = 1 : numSteps
          % Set up a new iteration object
          testItr = sltestiteration();

          % Set iteration settings
          setTestParam(testItr, 'SignalBuilderGroup', sltest_signalBuilderGroups{1}{k}, 'SimulationIndex', 1);
          setTestParam(testItr, 'SignalBuilderGroup', sltest_signalBuilderGroups{2}{k}, 'SimulationIndex', 2);

          % Register the iteration to run in this test case
          %    use SB group name for iteration name
          addIteration(sltest_testCase, testItr,sltest_signalBuilderGroups{1}{k});
      end

  case "SB_Equiv_Full_Cov_SLDV" [equivalence]
    simulation 1:
      model CruiseControl, harness CruiseControl_Harness_SB_SLDV
    simulation 2:
      model CruiseControl_SIL, harness CruiseControl_Harness_SB_SLDV_SIL
    equivalence criteria
      engaged
      tspeed
      Exp_engaged
      Exp_tspeed
      AccelResSw
      Brake
      CoastSetSw
      CruiseOnOff
      Speed
      engaged_Assertion
      tspeed_Assertion
    custom criteria (off): same code as in custom criteria (off) of case "SB_Equiv_Full_Cov_ReqsBased"
    iteration script: same code as in iteration script of case "SB_Equiv_Full_Cov_ReqsBased"

  case "SB_SIL_Full_Cov_ReqsBased" [baseline]
    model CruiseControl_SIL, harness CruiseControl_Harness_SB_Full_SIL
    baseline "assertBaseline.mat"
      tspeed_Assertion
      engaged_Assertion
    custom criteria (off): same code as in custom criteria (off) of case "SB_Equiv_Full_Cov_ReqsBased"
    iteration script:
      %% Iterate over all Signal Builder Groups.

      % Determine the number of possible iterations
      numSteps = length(sltest_signalBuilderGroups);

      % Create each iteration
      for k = 1 : numSteps
          % Set up a new iteration object
          testItr = sltestiteration();

          % Set iteration settings
          setTestParam(testItr, 'SignalBuilderGroup', sltest_signalBuilderGroups{k});

          % Register the iteration to run in this test case
          addIteration(sltest_testCase, testItr, sltest_signalBuilderGroups{k}); % You can pass in an optional iteration name
      end

  case "SB_Equiv_Full_Cov" [equivalence]
    simulation 1:
      model CruiseControl, harness CruiseControl_Harness_SB_Full
    simulation 2:
      model CruiseControl, harness CruiseControl_Harness_SB_Full, mode Software-in-the-Loop (SIL)
    equivalence criteria (2 of 9 signals compared)
      engaged
      tspeed
    custom criteria (off): same code as in custom criteria (off) of case "SB_Equiv_Full_Cov_ReqsBased"
    iteration script: same code as in iteration script of case "SB_Equiv_Full_Cov_ReqsBased"

suite "Dev"

  suite "Standalone_Harness"

    case "SB_Full_SIL" [baseline]
      model CruiseControl_StandaloneHarness_SB_Full_SIL
      baseline "assertBaseline.mat"
        tspeed_Assertion
        engaged_Assertion
      custom criteria (off): same code as in custom criteria (off) of case "SB_Equiv_Full_Cov_ReqsBased"
      iteration script:
        %% Iterate over all Signal Builder Groups.

        % Determine the number of possible iterations
        numSteps = length(sltest_signalBuilderGroups);

        % Create each iteration
        for k = 1 : numSteps
            % Set up a new iteration object
            testItr = sltestiteration();

            % Set iteration settings
            setTestParam(testItr, 'SignalBuilderGroup', sltest_signalBuilderGroups{k});

            % Register the iteration to run in this test case
            addIteration(sltest_testCase, testItr, sltest_signalBuilderGroups{k});
        end

    case "SB_Full_SIL_SimTest" [simulation]
      model CruiseControl_StandaloneHarness_SB_Full_SIL
      signal scenario: Init Not Enable or Engaged (CruiseControl_Harness_SB_Full_SIL/Harness Inputs)
      custom criteria (off): same code as in custom criteria (off) of case "SB_Equiv_Full_Cov_ReqsBased"

  suite "Equivalence_Test"

    case "SB_Equiv_Full_Coverage_Iterations" [equivalence]
      simulation 1:
        model CruiseControl, harness CruiseControl_Harness_SB_Full
        post-load callback:
          set_param([sltest_bdroot '/' sltest_sut],'SimulationMode','Normal');
      simulation 2:
        model CruiseControl, harness CruiseControl_Harness_SB_Full
        post-load callback:
          set_param([sltest_bdroot '/' sltest_sut],'SimulationMode','Software-in-the-loop (SIL)');
      equivalence criteria
        engaged
        tspeed
        Exp_engaged
        Exp_tspeed
        AccelResSw
        Brake
        CoastSetSw
        CruiseOnOff
        Speed
        engaged_Assertion
        tspeed_Assertion
      custom criteria (off): same code as in custom criteria (off) of case "SB_Equiv_Full_Cov_ReqsBased"
      iteration script: same code as in iteration script of case "SB_Equiv_Full_Cov_ReqsBased"

    case "SB_Equiv_Full_Coverage_SIL_Harness" [equivalence]
      simulation 1:
        model CruiseControl, harness CruiseControl_Harness_SB_Full
      simulation 2:
        model CruiseControl, harness CruiseControl_Harness_SB_Full_SIL
      equivalence criteria
        engaged
        tspeed
        Exp_engaged
        Exp_tspeed
        AccelResSw
        Brake
        CoastSetSw
        CruiseOnOff
        Speed
        engaged_Assertion
        tspeed_Assertion
      custom criteria (off): same code as in custom criteria (off) of case "SB_Equiv_Full_Cov_ReqsBased"
      iteration script: same code as in iteration script of case "SB_Equiv_Full_Cov_ReqsBased"

    case "SB_Equiv_Full_Coverage_SIL_StandaloneHarness" [equivalence]
      simulation 1:
        model CruiseControl, harness CruiseControl_Harness_SB_Full
      simulation 2:
        model CruiseControl_StandaloneHarness_SB_Full_SIL
      equivalence criteria
        engaged
        tspeed
        Exp_engaged
        Exp_tspeed
        AccelResSw
        Brake
        CoastSetSw
        CruiseOnOff
        Speed
        engaged_Assertion
        tspeed_Assertion
      custom criteria (off): same code as in custom criteria (off) of case "SB_Equiv_Full_Cov_ReqsBased"
      iteration script: same code as in iteration script of case "SB_Equiv_Full_Cov_ReqsBased"

    case "SB_Equiv_Full_Coverage_SIL_Block_StandaloneHarness" [equivalence]
      simulation 1:
        model CruiseControl, harness CruiseControl_Harness_SB_Full
      simulation 2:
        model CruiseControl_StandaloneHarness_SB_Full_SIL_Block
      equivalence criteria
        engaged
        tspeed
        Exp_engaged
        Exp_tspeed
        AccelResSw
        Brake
        CoastSetSw
        CruiseOnOff
        Speed
        engaged_Assertion
        tspeed_Assertion
      custom criteria (off): same code as in custom criteria (off) of case "SB_Equiv_Full_Cov_ReqsBased"
      iteration script: same code as in iteration script of case "SB_Equiv_Full_Cov_ReqsBased"

    suite "SB_Full_Equivalence"

      case "Init Not Enable or Engaged" [equivalence]
        simulation 1:
          model CruiseControl, harness CruiseControl_Harness_SB_Full
          signal scenario: Init Not Enable or Engaged
          post-load callback:
            set_param([sltest_bdroot '/' sltest_sut],'SimulationMode','Normal');
        simulation 2:
          model CruiseControl, harness CruiseControl_Harness_SB_Full
          signal scenario: Init Not Enable or Engaged
          post-load callback: same code as in post-load callback of case "SB_Equiv_Full_Coverage_Iterations"
        equivalence criteria
          engaged
          tspeed
          Exp_engaged
          Exp_tspeed
          AccelResSw
          Brake
          CoastSetSw
          CruiseOnOff
          Speed
          engaged_Assertion
          tspeed_Assertion
        custom criteria (off): same code as in custom criteria (off) of case "SB_Equiv_Full_Cov_ReqsBased"

      case "Not Engaged with Enable" [equivalence]
        simulation 1:
          model CruiseControl, harness CruiseControl_Harness_SB_Full
          signal scenario: Not Engaged with Enable
          post-load callback:
            set_param([sltest_bdroot '/' sltest_sut],'SimulationMode','Normal');
        simulation 2:
          model CruiseControl, harness CruiseControl_Harness_SB_Full
          signal scenario: Not Engaged with Enable
          post-load callback: same code as in post-load callback of case "SB_Equiv_Full_Coverage_Iterations"
        equivalence criteria
          engaged
          tspeed
          Exp_engaged
          Exp_tspeed
          AccelResSw
          Brake
          CoastSetSw
          CruiseOnOff
          Speed
          engaged_Assertion
          tspeed_Assertion
        custom criteria (off): same code as in custom criteria (off) of case "SB_Equiv_Full_Cov_ReqsBased"

      case "Disengage with Disable" [equivalence]
        simulation 1:
          model CruiseControl, harness CruiseControl_Harness_SB_Full
          signal scenario: Disengage with Disable
          post-load callback:
            set_param([sltest_bdroot '/' sltest_sut],'SimulationMode','Normal');
        simulation 2:
          model CruiseControl, harness CruiseControl_Harness_SB_Full
          signal scenario: Disengage with Disable
          post-load callback: same code as in post-load callback of case "SB_Equiv_Full_Coverage_Iterations"
        equivalence criteria
          engaged
          tspeed
          Exp_engaged
          Exp_tspeed
          AccelResSw
          Brake
          CoastSetSw
          CruiseOnOff
          Speed
          engaged_Assertion
          tspeed_Assertion
        custom criteria (off): same code as in custom criteria (off) of case "SB_Equiv_Full_Cov_ReqsBased"

      case "Engage 1st with CoastSetSW" [equivalence]
        simulation 1:
          model CruiseControl, harness CruiseControl_Harness_SB_Full
          signal scenario: Engage 1st with CoastSetSW
          post-load callback:
            set_param([sltest_bdroot '/' sltest_sut],'SimulationMode','Normal');
        simulation 2:
          model CruiseControl, harness CruiseControl_Harness_SB_Full
          signal scenario: Engage 1st with CoastSetSW
          post-load callback: same code as in post-load callback of case "SB_Equiv_Full_Coverage_Iterations"
        equivalence criteria
          engaged
          tspeed
          Exp_engaged
          Exp_tspeed
          AccelResSw
          Brake
          CoastSetSw
          CruiseOnOff
          Speed
          engaged_Assertion
          tspeed_Assertion
        custom criteria (off): same code as in custom criteria (off) of case "SB_Equiv_Full_Cov_ReqsBased"

      case "No Engage 1st with AccelResSW" [equivalence]
        simulation 1:
          model CruiseControl, harness CruiseControl_Harness_SB_Full
          signal scenario: No Engage 1st with AccelResSW
          post-load callback:
            set_param([sltest_bdroot '/' sltest_sut],'SimulationMode','Normal');
        simulation 2:
          model CruiseControl, harness CruiseControl_Harness_SB_Full
          signal scenario: No Engage 1st with AccelResSW
          post-load callback: same code as in post-load callback of case "SB_Equiv_Full_Coverage_Iterations"
        equivalence criteria
          engaged
          tspeed
          Exp_engaged
          Exp_tspeed
          AccelResSw
          Brake
          CoastSetSw
          CruiseOnOff
          Speed
          engaged_Assertion
          tspeed_Assertion
        custom criteria (off): same code as in custom criteria (off) of case "SB_Equiv_Full_Cov_ReqsBased"

      case "Disengage with Brake" [equivalence]
        simulation 1:
          model CruiseControl, harness CruiseControl_Harness_SB_Full
          signal scenario: Disengage with Brake
          post-load callback:
            set_param([sltest_bdroot '/' sltest_sut],'SimulationMode','Normal');
        simulation 2:
          model CruiseControl, harness CruiseControl_Harness_SB_Full
          signal scenario: Disengage with Brake
          post-load callback: same code as in post-load callback of case "SB_Equiv_Full_Coverage_Iterations"
        equivalence criteria
          engaged
          tspeed
          Exp_engaged
          Exp_tspeed
          AccelResSw
          Brake
          CoastSetSw
          CruiseOnOff
          Speed
          engaged_Assertion
          tspeed_Assertion
        custom criteria (off): same code as in custom criteria (off) of case "SB_Equiv_Full_Cov_ReqsBased"

      case "Re-Engage with CoastSetSw" [equivalence]
        simulation 1:
          model CruiseControl, harness CruiseControl_Harness_SB_Full
          signal scenario: Re-Engage with CoastSetSw
          post-load callback:
            set_param([sltest_bdroot '/' sltest_sut],'SimulationMode','Normal');
        simulation 2:
          model CruiseControl, harness CruiseControl_Harness_SB_Full
          signal scenario: Re-Engage with CoastSetSw
          post-load callback: same code as in post-load callback of case "SB_Equiv_Full_Coverage_Iterations"
        equivalence criteria
          engaged
          tspeed
          Exp_engaged
          Exp_tspeed
          AccelResSw
          Brake
          CoastSetSw
          CruiseOnOff
          Speed
          engaged_Assertion
          tspeed_Assertion
        custom criteria (off): same code as in custom criteria (off) of case "SB_Equiv_Full_Cov_ReqsBased"

      case "Re-Engage with AccelResSw" [equivalence]
        simulation 1:
          model CruiseControl, harness CruiseControl_Harness_SB_Full
          signal scenario: Re-Engage with AccelResSw
          post-load callback:
            set_param([sltest_bdroot '/' sltest_sut],'SimulationMode','Normal');
        simulation 2:
          model CruiseControl, harness CruiseControl_Harness_SB_Full
          signal scenario: Re-Engage with AccelResSw
          post-load callback: same code as in post-load callback of case "SB_Equiv_Full_Coverage_Iterations"
        equivalence criteria
          engaged
          tspeed
          Exp_engaged
          Exp_tspeed
          AccelResSw
          Brake
          CoastSetSw
          CruiseOnOff
          Speed
          engaged_Assertion
          tspeed_Assertion
        custom criteria (off): same code as in custom criteria (off) of case "SB_Equiv_Full_Cov_ReqsBased"

      case "Engaged Decel with CoastSetSW" [equivalence]
        simulation 1:
          model CruiseControl, harness CruiseControl_Harness_SB_Full
          signal scenario: Engaged Decel with CoastSetSW
          post-load callback:
            set_param([sltest_bdroot '/' sltest_sut],'SimulationMode','Normal');
        simulation 2:
          model CruiseControl, harness CruiseControl_Harness_SB_Full
          signal scenario: Engaged Decel with CoastSetSW
          post-load callback: same code as in post-load callback of case "SB_Equiv_Full_Coverage_Iterations"
        equivalence criteria
          engaged
          tspeed
          Exp_engaged
          Exp_tspeed
          AccelResSw
          Brake
          CoastSetSw
          CruiseOnOff
          Speed
          engaged_Assertion
          tspeed_Assertion
        custom criteria (off): same code as in custom criteria (off) of case "SB_Equiv_Full_Cov_ReqsBased"

      case "Engaged Accel with AccelResSW" [equivalence]
        simulation 1:
          model CruiseControl, harness CruiseControl_Harness_SB_Full
          signal scenario: Engaged Accel with AccelResSW
          post-load callback:
            set_param([sltest_bdroot '/' sltest_sut],'SimulationMode','Normal');
        simulation 2:
          model CruiseControl, harness CruiseControl_Harness_SB_Full
          signal scenario: Engaged Accel with AccelResSW
          post-load callback: same code as in post-load callback of case "SB_Equiv_Full_Coverage_Iterations"
        equivalence criteria
          engaged
          tspeed
          Exp_engaged
          Exp_tspeed
          AccelResSw
          Brake
          CoastSetSw
          CruiseOnOff
          Speed
          engaged_Assertion
          tspeed_Assertion
        custom criteria (off): same code as in custom criteria (off) of case "SB_Equiv_Full_Cov_ReqsBased"

      case "Engagd Decel with CoastSet Hold" [equivalence]
        simulation 1:
          model CruiseControl, harness CruiseControl_Harness_SB_Full
          signal scenario: Engagd Decel with CoastSet Hold
          post-load callback:
            set_param([sltest_bdroot '/' sltest_sut],'SimulationMode','Normal');
        simulation 2:
          model CruiseControl, harness CruiseControl_Harness_SB_Full
          signal scenario: Engagd Decel with CoastSet Hold
          post-load callback: same code as in post-load callback of case "SB_Equiv_Full_Coverage_Iterations"
        equivalence criteria
          engaged
          tspeed
          Exp_engaged
          Exp_tspeed
          AccelResSw
          Brake
          CoastSetSw
          CruiseOnOff
          Speed
          engaged_Assertion
          tspeed_Assertion
        custom criteria (off): same code as in custom criteria (off) of case "SB_Equiv_Full_Cov_ReqsBased"

      case "Engagd Accel with AccelRes Hold" [equivalence]
        simulation 1:
          model CruiseControl, harness CruiseControl_Harness_SB_Full
          signal scenario: Engagd Accel with AccelRes Hold
          post-load callback:
            set_param([sltest_bdroot '/' sltest_sut],'SimulationMode','Normal');
        simulation 2:
          model CruiseControl, harness CruiseControl_Harness_SB_Full
          signal scenario: Engagd Accel with AccelRes Hold
          post-load callback: same code as in post-load callback of case "SB_Equiv_Full_Coverage_Iterations"
        equivalence criteria
          engaged
          tspeed
          Exp_engaged
          Exp_tspeed
          AccelResSw
          Brake
          CoastSetSw
          CruiseOnOff
          Speed
          engaged_Assertion
          tspeed_Assertion
        custom criteria (off): same code as in custom criteria (off) of case "SB_Equiv_Full_Cov_ReqsBased"

      case "Engage CoastSetSw Veh Spd" [equivalence]
        simulation 1:
          model CruiseControl, harness CruiseControl_Harness_SB_Full
          signal scenario: Engage CoastSetSw Veh Spd
          post-load callback:
            set_param([sltest_bdroot '/' sltest_sut],'SimulationMode','Normal');
        simulation 2:
          model CruiseControl, harness CruiseControl_Harness_SB_Full
          signal scenario: Engage CoastSetSw Veh Spd
          post-load callback: same code as in post-load callback of case "SB_Equiv_Full_Coverage_Iterations"
        equivalence criteria
          engaged
          tspeed
          Exp_engaged
          Exp_tspeed
          AccelResSw
          Brake
          CoastSetSw
          CruiseOnOff
          Speed
          engaged_Assertion
          tspeed_Assertion
        custom criteria (off): same code as in custom criteria (off) of case "SB_Equiv_Full_Cov_ReqsBased"

      case "Engage AccelResSw Veh Spd" [equivalence]
        simulation 1:
          model CruiseControl, harness CruiseControl_Harness_SB_Full
          signal scenario: Engage AccelResSw Veh Spd
          post-load callback:
            set_param([sltest_bdroot '/' sltest_sut],'SimulationMode','Normal');
        simulation 2:
          model CruiseControl, harness CruiseControl_Harness_SB_Full
          signal scenario: Engage AccelResSw Veh Spd
          post-load callback: same code as in post-load callback of case "SB_Equiv_Full_Coverage_Iterations"
        equivalence criteria
          engaged
          tspeed
          Exp_engaged
          Exp_tspeed
          AccelResSw
          Brake
          CoastSetSw
          CruiseOnOff
          Speed
          engaged_Assertion
          tspeed_Assertion
        custom criteria (off): same code as in custom criteria (off) of case "SB_Equiv_Full_Cov_ReqsBased"

      case "Engage Veh Spd Edge" [equivalence]
        simulation 1:
          model CruiseControl, harness CruiseControl_Harness_SB_Full
          signal scenario: Engage Veh Spd Edge
          post-load callback:
            set_param([sltest_bdroot '/' sltest_sut],'SimulationMode','Normal');
        simulation 2:
          model CruiseControl, harness CruiseControl_Harness_SB_Full
          signal scenario: Engage Veh Spd Edge
          post-load callback: same code as in post-load callback of case "SB_Equiv_Full_Coverage_Iterations"
        equivalence criteria
          engaged
          tspeed
          Exp_engaged
          Exp_tspeed
          AccelResSw
          Brake
          CoastSetSw
          CruiseOnOff
          Speed
          engaged_Assertion
          tspeed_Assertion
        custom criteria (off): same code as in custom criteria (off) of case "SB_Equiv_Full_Cov_ReqsBased"

      case "Disengage Veh Spd Edge" [equivalence]
        simulation 1:
          model CruiseControl, harness CruiseControl_Harness_SB_Full
          signal scenario: Disengage Veh Spd Edge
          post-load callback:
            set_param([sltest_bdroot '/' sltest_sut],'SimulationMode','Normal');
        simulation 2:
          model CruiseControl, harness CruiseControl_Harness_SB_Full
          signal scenario: Disengage Veh Spd Edge
          post-load callback: same code as in post-load callback of case "SB_Equiv_Full_Coverage_Iterations"
        equivalence criteria
          engaged
          tspeed
          Exp_engaged
          Exp_tspeed
          AccelResSw
          Brake
          CoastSetSw
          CruiseOnOff
          Speed
          engaged_Assertion
          tspeed_Assertion
        custom criteria (off): same code as in custom criteria (off) of case "SB_Equiv_Full_Cov_ReqsBased"

      case "Disengage from CoastSet Hold" [equivalence]
        simulation 1:
          model CruiseControl, harness CruiseControl_Harness_SB_Full
          signal scenario: Disengage from CoastSet Hold
          post-load callback:
            set_param([sltest_bdroot '/' sltest_sut],'SimulationMode','Normal');
        simulation 2:
          model CruiseControl, harness CruiseControl_Harness_SB_Full
          signal scenario: Disengage from CoastSet Hold
          post-load callback: same code as in post-load callback of case "SB_Equiv_Full_Coverage_Iterations"
        equivalence criteria
          engaged
          tspeed
          Exp_engaged
          Exp_tspeed
          AccelResSw
          Brake
          CoastSetSw
          CruiseOnOff
          Speed
          engaged_Assertion
          tspeed_Assertion
        custom criteria (off): same code as in custom criteria (off) of case "SB_Equiv_Full_Cov_ReqsBased"

      case "Disengage from AccelRes Hold" [equivalence]
        simulation 1:
          model CruiseControl, harness CruiseControl_Harness_SB_Full
          signal scenario: Disengage from AccelRes Hold
          post-load callback:
            set_param([sltest_bdroot '/' sltest_sut],'SimulationMode','Normal');
        simulation 2:
          model CruiseControl, harness CruiseControl_Harness_SB_Full
          signal scenario: Disengage from AccelRes Hold
          post-load callback: same code as in post-load callback of case "SB_Equiv_Full_Coverage_Iterations"
        equivalence criteria
          engaged
          tspeed
          Exp_engaged
          Exp_tspeed
          AccelResSw
          Brake
          CoastSetSw
          CruiseOnOff
          Speed
          engaged_Assertion
          tspeed_Assertion
        custom criteria (off): same code as in custom criteria (off) of case "SB_Equiv_Full_Cov_ReqsBased"

      case "Disengage Veh Spd Edge Hold" [equivalence]
        simulation 1:
          model CruiseControl, harness CruiseControl_Harness_SB_Full
          signal scenario: Disengage Veh Spd Edge Hold
          post-load callback:
            set_param([sltest_bdroot '/' sltest_sut],'SimulationMode','Normal');
        simulation 2:
          model CruiseControl, harness CruiseControl_Harness_SB_Full
          signal scenario: Disengage Veh Spd Edge Hold
          post-load callback: same code as in post-load callback of case "SB_Equiv_Full_Coverage_Iterations"
        equivalence criteria
          engaged
          tspeed
          Exp_engaged
          Exp_tspeed
          AccelResSw
          Brake
          CoastSetSw
          CruiseOnOff
          Speed
          engaged_Assertion
          tspeed_Assertion
        custom criteria (off): same code as in custom criteria (off) of case "SB_Equiv_Full_Cov_ReqsBased"

suite "SIL_Test"

  case "SB_Full_Coverage_SLDV" [baseline]
    model CruiseControl_SIL, harness CruiseControl_Harness_SB_SLDV_SIL
    baseline "assertBaseline.mat"
      tspeed_Assertion
      engaged_Assertion
    custom criteria (off): same code as in custom criteria (off) of case "SB_Equiv_Full_Cov_ReqsBased"
    iteration script:
      %% Iterate over all Signal Builder Groups.

      % Determine the number of possible iterations
      numSteps = length(sltest_signalBuilderGroups);

      % Create each iteration
      for k = 1 : numSteps
          % Set up a new iteration object
          testItr = sltestiteration();

          % Set iteration settings
          setTestParam(testItr, 'SignalBuilderGroup', sltest_signalBuilderGroups{k});

          % Register the iteration to run in this test case
          addIteration(sltest_testCase, testItr,sltest_signalBuilderGroups{k}); % You can pass in an optional iteration name
      end

suite "Temporal Assessment Language"

  case "Disengage With Brake" [simulation]
    model CruiseControl, harness CruiseControl_Harness_SigEditor
    signal scenario: Disengage_with_Brake (CruiseControl_Harness_SigEditor/TestCases)
    input "InitNotEnableOrEngaged" from CruiseControlTests_Import_Std.xlsx (active)
    input "NotEngagedWithEnable" from CruiseControlTests_Import_Std.xlsx
    input "DisengageWithDisable" from CruiseControlTests_Import_Std.xlsx
    input "Engage1stWithCoastSetSW" from CruiseControlTests_Import_Std.xlsx
    input "NoEngage1stWithAccelResSW" from CruiseControlTests_Import_Std.xlsx
    input "DisengageWithBrake" from CruiseControlTests_Import_Std.xlsx
    assessment "DisengageWithBrake_tal": At any point of time, whenever Brake is true then, with no delay, ~engaged must be true
    assessment "Assessment100": At any point of time, if ~engaged becomes true then, with no delay, ~engaged must be true
      Brake: signal CruiseControl_Harness_SigEditor/Input Conversion Subsystem, port 2
      engaged: signal CruiseControl_Harness_SigEditor/CruiseControl, port 1
    iterations:
      Disengage_with_Brake: SignalBuilderGroup "Disengage_with_Brake", Assessments "[\"DisengageWithBrake_tal\",\"Assessment100\"]"
      Disengage_with_Disable: SignalBuilderGroup "Disengage_with_Disable", Assessments "[\"Assessment2\"]"
      Engage_1st_with_CoastSetSW: SignalBuilderGroup "Engage_1st_with_CoastSetSW", Assessments "[\"Assessment2\"]"
      Init_Not_Enable_or_Engaged: SignalBuilderGroup "Init_Not_Enable_or_Engaged"
      No_Engage_1st_with_AccelResSW: SignalBuilderGroup "No_Engage_1st_with_AccelResSW"
      Not_Engaged_with_Enable: SignalBuilderGroup "Not_Engaged_with_Enable"

  case "HarnessSupported" [simulation]
    model CruiseControl_TAL, harness CruiseControl_Harness_SigEditor
    input "InitNotEnableOrEngaged" from CruiseControlTests_Import_Std.xlsx (active)
    input "NotEngagedWithEnable" from CruiseControlTests_Import_Std.xlsx
    input "DisengageWithDisable" from CruiseControlTests_Import_Std.xlsx
    input "Engage1stWithCoastSetSW" from CruiseControlTests_Import_Std.xlsx
    input "NoEngage1stWithAccelResSW" from CruiseControlTests_Import_Std.xlsx
    input "DisengageWithBrake" from CruiseControlTests_Import_Std.xlsx
    assessment "Disengage_With_Brake": At any point of time, whenever Brake & engaged_was is true then, with no delay, ~engaged must be true
    assessment "Disengage_with_Disable": At any point of time, if ~CruiseOnOff & CruiseOnOff_was & engaged_was becomes true then, with no delay, ~engaged must be true
    assessment "Enage_1st_with_CoastSetSw": At any point of time, whenever CoastSetSw & engaged_never_was & Speed>=mintspeed & Speed<=maxtspeed is true then, with no delay, engaged must be true
    assessment "Init_Not_Enable_or_Engaged": At any point of time, whenever ~CruiseOnOff is true then, with no delay, ~engaged & tspeed==uint8(0) must be true
    assessment "No_Engage_1st_with_AccelResSW": At any point of time, whenever AccelRestSw & engaged_never_was & Speed>=mintspeed & Speed<=maxtspeed is true then, with no delay, ~engaged must be true
    assessment "Not_Engaged_with_Enable": At any point of time, if CruiseOnOff becomes true then, with no delay, ~engaged & tspeed==uint8(0) must be true
      Brake: signal CruiseControl_Harness_SigEditor/Input Conversion Subsystem, port 2
      engaged: signal CruiseControl_Harness_SigEditor/CruiseControl, port 1
      engaged_was: signal CruiseControl_Harness_SigEditor/TAL_helper/Unit Delay5, port 1
      CruiseOnOff: signal CruiseControl_Harness_SigEditor/Input Conversion Subsystem, port 1
      CruiseOnOff_was: signal CruiseControl_Harness_SigEditor/TAL_helper/Unit Delay, port 1
      CoastSetSw: signal CruiseControl_Harness_SigEditor/Input Conversion Subsystem, port 4
      mintspeed: variable CruiseControl_Harness_SigEditor/CruiseControl
      maxtspeed: variable CruiseControl_Harness_SigEditor/CruiseControl
      Speed: signal CruiseControl_Harness_SigEditor/Input Conversion Subsystem, port 3
      engaged_never_was: signal CruiseControl_Harness_SigEditor/TAL_helper/Unit Delay8, port 1
      tspeed: signal CruiseControl_Harness_SigEditor/CruiseControl, port 2
      AccelRestSw: signal CruiseControl_Harness_SigEditor/Input Conversion Subsystem, port 5
    iterations:
      Disengage_with_Brake: SignalBuilderGroup "Disengage_with_Brake", Assessments "[\"Disengage_With_Brake\"]"
      Disengage_with_Disable: SignalBuilderGroup "Disengage_with_Disable", Assessments "[\"Disengage_with_Disable\"]"
      Engage_1st_with_CoastSetSW: SignalBuilderGroup "Engage_1st_with_CoastSetSW", Assessments "[\"Enage_1st_with_CoastSetSw\"]"
      Init_Not_Enable_or_Engaged: SignalBuilderGroup "Init_Not_Enable_or_Engaged", Assessments "[\"Init_Not_Enable_or_Engaged\"]"
      No_Engage_1st_with_AccelResSW: SignalBuilderGroup "No_Engage_1st_with_AccelResSW", Assessments "[\"No_Engage_1st_with_AccelResSW\"]"
      Not_Engaged_with_Enable: SignalBuilderGroup "Not_Engaged_with_Enable", Assessments "[\"Not_Engaged_with_Enable\"]"